# Grasshopper definition Joint_Test_Implementation.gh (Grasshopper 0.9.80)
# plug-ins: Python Interpreter

python = PythonScript()  # -> Out, A
dividecurve = PythonScript()  # -> out, global_points, line_1, line_2, beam_breps, spheres_angles, recs, pyramid_list, intersection
# ---------- dividecurve: Python ----------
# snippet of code to make this python component look for it's code in the parent folder of the .gh file

import os

ghComp = ghenv.Component
ghDoc = ghComp.OnPingDocument()

file_name = "posSpace.py"
gh_file_location = ghDoc.FilePath
parent = os.path.dirname(os.path.realpath(gh_file_location))

file_path = os.path.join(parent, file_name)
print file_path

parent = os.path.dirname(os.path.realpath(parent))
parent = os.path.dirname(os.path.realpath(parent))
print parent

# hacky-hacky run-fun
execfile(file_path)
# ---------- end dividecurve ----------
brep = Brep(dividecurve.pyramid_list)
brep_2 = Brep(dividecurve.beam_breps)
brep_3 = Brep(dividecurve.spheres_angles)
brep_4 = Brep(dividecurve.intersection)
crv = Curve([dividecurve.line_1, dividecurve.line_2])
crv_2 = Curve(dividecurve.recs)
panel = Panel(dividecurve.out)
