# Grasshopper definition KeystoneDebugging.gh (Grasshopper 0.9.80)
# plug-ins: Python Interpreter

srf = Surface([<surface referenced from the Rhino model> x3])
srf_2 = Surface([<surface referenced from the Rhino model> x3])
srf_3 = Surface(<surface referenced from the Rhino model>)
srf_4 = Surface([<surface referenced from the Rhino model> x3])
rev = ReverseList(List=srf_2)
item = ListItem(List=rev, Index=Slider(0, range=0..3), Wrap=True)
merge = Merge(Data1=rev, Data2=srf_4)
python = PythonScript(v_div=Slider(6, range=0..10), blend_p=Slider(6, range=0..10), srf_set_a=srf, srf_set_b=srf_4, srf=srf_3)  # -> out, a, b, unpacked_source, unpacked_keystones, d, c, e; inputs v_div: Int32, blend_p: Int32, srf_set_a: list of Surface, srf_set_b: list of Surface, srf: Surface
# ---------- python: Python ----------
execfile("/Users/jonas/Dropbox/0.dfab/Trimester 2/Project I - Gradual Assemblies/Gradual-Assemblies/UR_Control/geometry/surface_keystone.py")

set = srf
set_2 = [srf_set_a, srf_set_b]
set = srf_set_a

keystone =  Keystone(set_2, v_div, blend_p, 1)
# a = keystone.temp_new_sets_pos
b, c = keystone.output()
print b
# e = keystone.poop
d = []
# ---------- end python ----------
item_2 = ListItem(List=python.unpacked_keystones, Index=0, Wrap=True)  # -> Item, Item1
srf_5 = Surface(python.unpacked_keystones)
panel = Panel(python.out)
