# Grasshopper definition uvFieldFunction.gh (Grasshopper 0.9.80)
# plug-ins: Python Interpreter

amplitude = Number(Slider(5, range=0.5..10))
u_shift_value = Number(Slider(5, range=0..20))
period = Number(Slider(10, range=1..50))
iterations = Number(Slider(4, range=1..10))
srf = Surface(<surface referenced from the Rhino model>)
list = ValueList({"None": 0, "u swap": 1, "v swap": 2, "uv-swap": 3}, selected="uv-swap")
merge = Merge(Data1=amplitude, Data2=period, Data3=iterations, Data4=u_shift_value)
srf_2 = Surface(<surface referenced from the Rhino model>)
list_2 = ValueList({"None": 0, "Sin": 1, "Surface": 2}, selected="Surface")
num = Number()
dividecurve = PythonScript(
    surfaces=srf,
    u_divisions=Slider(39, range=10..100),
    v_divisions=Slider(70, range=10..100),
    warp_type=list_2,
    swap_uv=Toggle(True),
    change_direction=list,
    sin_parameters=merge,
    reference_surface=srf_2)  # -> out, global_points, line_1, line_2, beam_breps, spheres_angles, surface, point_list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; inputs surfaces: Surface, warp_type: Int32, swap_uv: Boolean, change_direction: Int32, sin_parameters: list, reference_surface: Surface
# ---------- dividecurve: Python ----------
# snippet of code to make this python component look for it's code in the parent folder of the .gh file

import os

ghComp = ghenv.Component
ghDoc = ghComp.OnPingDocument()

file_name = "uvFieldFunction.py"
gh_file_location = ghDoc.FilePath
parent = os.path.dirname(os.path.realpath(gh_file_location))

file_path = os.path.join(parent, file_name)
print file_path

parent = os.path.dirname(os.path.realpath(parent))
parent = os.path.dirname(os.path.realpath(parent))
print parent

# hacky-hacky run-fun
execfile(file_path)
# ---------- end dividecurve ----------
crv = Curve(dividecurve.isocurves_u)
brep = Brep(dividecurve.surface)
pt = Point(dividecurve.point_list)
pt_2 = Point(dividecurve.pts)
sdivide = DivideSurface(Surface=brep, UCount=10, VCount=10)  # -> Points, Normals, Parameters
panel = Panel(dividecurve.out)
item = ListItem(List=pt, Index=Slider(410, range=10..2000), Wrap=True)
pt_3 = Point(item)
