# Grasshopper definition 190122_Assembly_test.gh (Grasshopper 1.0.4)

# ---- group: parameters
offset_elipse = Slider(22, range=0..100)
divide_elipse = Slider(6, range=0..25)
pt = ConstructPoint(XCoordinate=0, YCoordinate=0, ZCoordinate=Slider(17, range=0..100))
radius_x = Slider(106, range=0..200)
beam_x = Slider(145, range=0..200)
radius_z = Slider(107, range=0..200)
rotation_elipse = Slider(0, range=0..180)
beam_y = Slider(10, range=0..100)
beam_z = Slider(4, range=0..1000)
beam_rotation = Slider(3, range=0..100)
beam_shift_0 = Slider(90, range=0..100)
beam_shift_1 = Slider(59, range=0..100)
neg = Negative(Value=radius_x)
neg_2 = Negative(Value=rotation_elipse)
neg_3 = Negative(Value=offset_elipse)

# ----
of_elipses = Slider(5, range=0..10)
rad = Radians(Degrees=beam_shift_0)
rad_2 = Radians(Degrees=beam_shift_1)

# ---- group: elipse
xz = XZPlane(Origin=pt)
X = UnitX(Factor=[radius_x, neg])
move = Move(Geometry=pt, Motion=X)  # -> Geometry, Transform
xy = XYPlane(Origin=pt)
yz = YZPlane(Origin=pt)
ellipse = Ellipse(Plane=xz, Radius1=radius_x, Radius2=radius_z)  # -> graft(Ellipse), Focus1, Focus2
item = ListItem(List=ellipse.Ellipse, Index=0, Wrap=True)

# ---- group: rotation/offset
dom = ConstructDomain(DomainStart=neg_2, DomainEnd=rotation_elipse)
range = Range(Domain=dom, Steps=of_elipses)  # -> flatten(Range)
rot3d = Rotate3D(Geometry=item, Angle=degrees(range), Center=Point(0, 0, 0), Axis=yz)  # -> flatten(Geometry), Transform
shift = ShiftList(List=rot3d.Geometry, Shift=9, Wrap=True)
dom_2 = ConstructDomain(DomainStart=offset_elipse, DomainEnd=neg_3)
range_2 = Range(Domain=dom_2, Steps=of_elipses)  # -> flatten(Range)
Y = UnitY(Factor=range_2)
move_2 = Move(Geometry=rot3d.Geometry, Motion=Y)  # -> flatten(Geometry), Transform

# ---- group: points on curve
len = Length(Curve=ellipse.Ellipse)
panel = Panel("""0
1""")
panel_2 = Panel("""1
0""")
cull = CullPattern(List=move_2.Geometry, CullPattern=panel)  # -> flatten(List)
shatter = Shatter(Curve=cull, Parameters=rad)
cull_2 = CullPattern(List=move_2.Geometry, CullPattern=panel_2)  # -> flatten(List)
division = Division(A=len, B=divide_elipse)
divlength = DivideLength(Curve=shatter, Length=division)  # -> Points, Tangents, Parameters
pull = PullPoint(Point=divlength.Points, Geometry=cull, Closest=True)  # -> simplify(ClosestPoint), Distance

# ----
shatter_2 = Shatter(Curve=cull_2, Parameters=rad_2)
divlength_2 = DivideLength(Curve=shatter_2, Length=division)  # -> Points, Tangents, Parameters
pull_2 = PullPoint(Point=divlength_2.Points, Geometry=cull, Closest=True)  # -> simplify(ClosestPoint), Distance
pl = ConstructPlane(Origin=divlength_2.Points, XAxis=divlength_2.Tangents, YAxis=Vector(0, 1, 0))  # -> simplify(Plane)
pl_2 = ConstructPlane(Origin=divlength.Points, XAxis=divlength.Tangents, YAxis=Vector(0, 1, 0))  # -> simplify(Plane)
number_slider = Slider(0.84, range=0..1)
pdecon = Deconstruct(Point=pl_2)  # -> XComponent, YComponent, ZComponent
pdecon_2 = Deconstruct(Point=pl)  # -> XComponent, YComponent, ZComponent
larger = LargerThan(FirstNumber=pdecon.ZComponent, SecondNumber="0")  # -> LargerThan, OrEqualTo
larger_2 = LargerThan(FirstNumber=pdecon_2.ZComponent, SecondNumber="0")  # -> LargerThan, OrEqualTo
dispatch = Dispatch(List=pl_2, DispatchPattern=larger.OrEqualTo)  # -> ListA, ListB
dispatch_2 = Dispatch(List=pl, DispatchPattern=larger_2.OrEqualTo)  # -> ListA, ListB
pdecon_3 = Deconstruct(Point=dispatch_2.ListA)  # -> XComponent, YComponent, ZComponent
pdecon_4 = Deconstruct(Point=dispatch.ListA)  # -> XComponent, YComponent, ZComponent
sort = SortList(Keys=pdecon_3.XComponent, ValuesA=dispatch_2.ListA)  # -> Keys, ValuesA
sort_2 = SortList(Keys=pdecon_4.XComponent, ValuesA=dispatch.ListA)  # -> Keys, ValuesA
deplane = DeconstructPlane(Plane=sort.ValuesA)  # -> Origin, XAxis, YAxis, ZAxis
deplane_2 = DeconstructPlane(Plane=sort_2.ValuesA)  # -> Origin, XAxis, YAxis, ZAxis
pl_3 = ConstructPlane(Origin=deplane.Origin, XAxis=deplane.XAxis, YAxis=deplane.ZAxis)
number_slider_2 = Slider(500, range=0..1000)
pl_4 = ConstructPlane(Origin=deplane_2.Origin, XAxis=deplane_2.XAxis, YAxis=deplane_2.ZAxis)
pln = Plane(pl_3)
pln_2 = Plane(pl_4)
X_2 = UnitX(Factor=number_slider_2)
move_3 = Move(Geometry=pln, Motion=X_2)  # -> Geometry, Transform
move_4 = Move(Geometry=pln_2, Motion=X_2)  # -> Geometry, Transform
pt_2 = ConstructPoint(XCoordinate=number_slider_2, YCoordinate=0, ZCoordinate=0)
xz_2 = XZPlane(Origin=pt_2)
xy_2 = XYPlane(Origin=pt_2)
panel_3 = Panel(pln)
orient = Orient(Geometry=move_4.Geometry, Source=xz_2, Target=xy_2)  # -> Geometry, Transform
orient_2 = Orient(Geometry=move_3.Geometry, Source=xz_2, Target=xy_2)  # -> Geometry, Transform
python = GhPythonScript(normal_list=orient_2.Geometry, shifted_list=orient.Geometry, dx=beam_x, dy=beam_y, dz=beam_z, radius="1")  # -> out, temp_geom, normal_beams, shifted_beams; inputs normal_list: tree of Plane, shifted_list: tree of Plane
# ---------- python: Python ----------
import rhinoscriptsyntax as rs
import Rhino.Geometry as rg
import math
import clr
clr.AddReference("Grasshopper")
import Grasshopper.Kernel.Data.GH_Path as ghpath
import Grasshopper.DataTree as datatree
from geometry.beam import Beam
from geometry.dowel import Dowel
from geometry.hole import Hole
import System

temp_geom = []

normal_beams = datatree[System.Object]()
shifted_beams = datatree[System.Object]()

for path in normal_list.Paths:
    for plane in normal_list.Branch(path):
        beam = Beam(plane, dx, dy, dz)
        normal_beams.Add(beam, path)

for path in shifted_list.Paths:
    for plane in shifted_list.Branch(path):
        beam = Beam(plane, dx, dy, dz)
        shifted_beams.Add(beam, path)

def get_dowel(beam, line_1, line_2):

    succeeded, p1, p2 = line_1.ClosestPoints(line_2)
    
    if succeeded:
        
        plane = rg.Plane(p1, beam.base_plane.Normal)
        return Dowel(plane, dowel_radius=radius)

    else:

        return None

n_list = shifted_beams

for branch_index, beams in enumerate(normal_beams.Branches):

    for list_index, beam in enumerate(beams):
        
        """
        normal beams
        """
        
        has_hole = True

        if list_index > 1:
            
            line_1 = beam.get_baseline().ToNurbsCurve()
            line_2 = beams[list_index - 1].get_baseline().ToNurbsCurve()
            
        elif list_index < len(beams) - 1:
            
            line_1 = beam.get_baseline().ToNurbsCurve()
            line_2 = beams[list_index + 1].get_baseline().ToNurbsCurve()
        
        else:
            
            has_hole = False
        
        if has_hole:

            dowel = get_dowel(beam, line_1, line_2)
            if dowel:
                beam.add_dowel(dowel)
                temp_geom.append(dowel.base_plane)
        
        """
        shifted beams
        """
        
        tmp_shifted_beams = shifted_beams.Branches[branch_index]
        
        if list_index >= 1:

            shifted_beam = tmp_shifted_beams[list_index - 1]
        
            line_1 = beam.get_baseline().ToNurbsCurve()
            line_2 = shifted_beam.get_baseline().ToNurbsCurve()

            dowel = get_dowel(beam, line_1, line_2)
            if dowel:
                beam.add_dowel(dowel)
                shifted_beam.add_dowel(dowel)
                temp_geom.append(dowel.base_plane)

        if list_index < len(tmp_shifted_beams):
            
            shifted_beam = tmp_shifted_beams[list_index]
        
            line_1 = beam.get_baseline().ToNurbsCurve()
            line_2 = shifted_beam.get_baseline().ToNurbsCurve()

            dowel = get_dowel(beam, line_1, line_2)
            if dowel:
                beam.add_dowel(dowel)
                shifted_beam.add_dowel(dowel)
                temp_geom.append(dowel.base_plane)


for branch_index, beams in enumerate(shifted_beams.Branches):

    for list_index, beam in enumerate(beams):
        
        """
        shifted beams
        """
        
        if list_index > 1:
            
            line_1 = beam.get_baseline().ToNurbsCurve()
            line_2 = beams[list_index - 1].get_baseline().ToNurbsCurve()
            
        elif list_index < len(beams) - 1:
            
            line_1 = beam.get_baseline().ToNurbsCurve()
            line_2 = beams[list_index + 1].get_baseline().ToNurbsCurve()

        else:
            
            continue
        
        dowel = get_dowel(beam, line_1, line_2)
        if dowel:
            beam.add_dowel(dowel)
            temp_geom.append(dowel.base_plane)


for path in normal_beams.Paths:
    for beam in normal_beams.Branch(path):
        
        temp_geom.append(beam.brep_representation())

for path in shifted_beams.Paths:
    for beam in shifted_beams.Branch(path):
        
        temp_geom.append(beam.brep_representation())
# ---------- end python ----------
geo = Geometry(python.temp_geom)
python_2 = GhPythonScript(normal_beams=python.normal_beams, shifted_beams=python.shifted_beams)  # -> out, safe_planes, top_planes, bottom_planes, beam_breps; inputs normal_beams: list, shifted_beams: list
# ---------- python_2: Python ----------
__author__ = "ytakzk"
__version__ = "2019.01.22"

import Rhino.Geometry as rg
from geometry.hole import Hole

beams = normal_beams
beams.extend(shifted_beams)

safe_planes, top_planes, bottom_planes, beam_breps = Hole.get_tool_planes_as_tree(beams,
    target_plane=rg.Plane.WorldXY,
    safe_plane_diff=100)
# ---------- end python_2 ----------
panel_4 = Panel(python.temp_geom)
panel_5 = Panel(python_2.beam_breps)
brep = Brep(python_2.beam_breps)
