# Grasshopper definition BeamClassImplementation.gh (Grasshopper 1.0.4)
# plug-ins: Python Interpreter

pt = ConstructPoint(XCoordinate=Slider(-0.142, range=-1..1), YCoordinate=Slider(0.248, range=-1..1), ZCoordinate=Slider(-0.248, range=-1..1))
pt_2 = ConstructPoint(XCoordinate=Slider(-0.142, range=-1..1), YCoordinate=Slider(0.248, range=-1..1), ZCoordinate=Slider(-0.248, range=-1..1))
pt_3 = Point(Point(-349.5694096, 492.4950717, 0))
pt_4 = Point(Point(0, 0, 0))
xy = XYPlane(Origin=Point(0, 0, 0))
pl = PlaneNormal(Origin=pt_3, ZAxis=pt)
pl_2 = PlaneNormal(Origin=pt_4, ZAxis=pt_2)
line_script_gen = PythonScript(
    origin_plane=pl,
    o_2=pl_2,
    size_x=Slider(1594, range=0..2000),
    size_y=Slider(100, range=0..200),
    size_z=Slider(100, range=0..200))  # -> out, a, b, c, line_repr; inputs origin_plane: Plane, o_2: Plane, size_x: Int32, size_y: Int32, size_z: Int32
# ---------- line_script_gen: Python ----------
# snippet of code to make this python component look for it's code in the parent folder of the .gh file

import os

ghComp = ghenv.Component
ghDoc = ghComp.OnPingDocument()

file_name = "beamClass.py"
gh_file_location = ghDoc.FilePath
parent = os.path.dirname(os.path.realpath(gh_file_location))

file_path = os.path.join(parent, file_name)
print file_path

# hacky-hacky run-fun
execfile(file_path)
# ---------- end line_script_gen ----------
panel = Panel(line_script_gen.out)
