# Grasshopper definition geometry_test_file.gh (Grasshopper 0.9.80)
# plug-ins: Python Interpreter

srf = Surface(<surface referenced from the Rhino model>)
srf_2 = Surface(<surface referenced from the Rhino model>)
srf_3 = Surface(<surface referenced from the Rhino model>)
srf_4 = Surface(<surface referenced from the Rhino model>)
surface_trimming = PythonScript(srf=srf, value=Slider(20, range=0..100), v_div=Slider(7, range=0..20))  # -> out, isocurves, temp_surface, hole_visualisation; inputs srf: Surface, value: Int32, v_div: Int32
# ---------- surface_trimming: Python ----------
# snippet of code to make this python component look for it's code in the parent folder of the .gh file

import os

ghComp = ghenv.Component
ghDoc = ghComp.OnPingDocument()

file_name = "surface_offset.py"
gh_file_location = ghDoc.FilePath
parent = os.path.dirname(os.path.realpath(gh_file_location))

file_path = os.path.join(parent, file_name)
# print file_path

single_parent = os.path.dirname(os.path.realpath(parent))
double_parent = os.path.dirname(os.path.realpath(single_parent))
# print parent

# hacky-hacky run-fun
execfile(file_path)
# ---------- end surface_trimming ----------
surface_keystoning = PythonScript(srf_1=srf_2, srf_2=srf_3, srf_3=srf_4)  # -> out, isocurve_visualisation, temp_surface, hole_visualisation; inputs srf_1: Surface, srf_2: Surface, srf_3: Surface
# ---------- surface_keystoning: Python ----------
# snippet of code to make this python component look for it's code in the parent folder of the .gh file

import os

ghComp = ghenv.Component
ghDoc = ghComp.OnPingDocument()

file_name = "surface_keystone.py"
gh_file_location = ghDoc.FilePath
parent = os.path.dirname(os.path.realpath(gh_file_location))

file_path = os.path.join(parent, file_name)
# print file_path

single_parent = os.path.dirname(os.path.realpath(parent))
double_parent = os.path.dirname(os.path.realpath(single_parent))
# print parent

# hacky-hacky run-fun
execfile(file_path)
# ---------- end surface_keystoning ----------
crv = Curve(surface_keystoning.isocurve_visualisation)
panel = Panel(surface_keystoning.out)
