# Grasshopper definition geometry_test_file_3.gh (Grasshopper 0.9.80)
# plug-ins: Python Interpreter

srf = Surface([<surface referenced from the Rhino model> x4])
srf_2 = Surface([<surface referenced from the Rhino model> x3])
srf_3 = Surface([<surface referenced from the Rhino model> x3])
srf_4 = Surface(<surface referenced from the Rhino model>)
srf_5 = Surface(<surface referenced from the Rhino model>)
srf_6 = Surface(<surface referenced from the Rhino model>)
srf_7 = Surface(<surface referenced from the Rhino model>)
srf_8 = Surface(<surface referenced from the Rhino model>)
srf_9 = Surface([<surface referenced from the Rhino model> x4])
srf_10 = Surface([<surface referenced from the Rhino model> x3])
srf_11 = Surface([<surface referenced from the Rhino model> x3])
swatch = ColourSwatch(SwatchColor=RGB(255, 255, 161))
srf_12 = Surface([<surface referenced from the Rhino model> x3])
srf_13 = Surface(<surface referenced from the Rhino model>)
srf_14 = Surface(<surface referenced from the Rhino model>)
srf_15 = Surface(<surface referenced from the Rhino model>)
srf_16 = Surface(<surface referenced from the Rhino model>)
srf_17 = Surface(<surface referenced from the Rhino model>)
srf_18 = Surface([<surface referenced from the Rhino model> x3])
preview = CustomPreview(Shader={ambient=RGB(0, 0, 0), diffuse=RGB(255, 105, 180), emission=RGB(76, 32, 54), shine=0.5, specular=RGB(255, 255, 255), transparency=0})
surface_keystoning = PythonScript(
    srf_1=srf_6,
    srf_2=srf_7,
    srf_3=srf_8,
    srf_4=srf_5,
    srf_set=srf_2,
    blend_precision=Slider(13, range=0..15),
    v_div=Slider(10, range=0..15),
    dir=Toggle(True))  # -> out, isocurve_visualisation, blend_crvs_vis, crv_vis, keystone_srfs, split_crvs, uv_switched_crvs, uv_switched_pts; inputs srf_1: Surface, srf_2: Surface, srf_3: Surface, srf_4: Surface, srf_set: list of Surface, blend_precision: Int32, dir: Int32
# ---------- surface_keystoning: Python ----------
# snippet of code to make this python component look for it's code in the parent folder of the .gh file

import os

ghComp = ghenv.Component
ghDoc = ghComp.OnPingDocument()

file_name = "surface_keystone.py"
gh_file_location = ghDoc.FilePath
parent = os.path.dirname(os.path.realpath(gh_file_location))

file_path = os.path.join(parent, file_name)
# print file_path

single_parent = os.path.dirname(os.path.realpath(parent))
double_parent = os.path.dirname(os.path.realpath(single_parent))
# print parent

# hacky-hacky run-fun
execfile(file_path)
# ---------- end surface_keystoning ----------
merge = Merge(Data1=srf_6, Data2=srf_7, Data3=srf_8, Data4=srf_5, Data5=srf_4)
merge_2 = Merge(Data1=srf_15, Data2=srf_16, Data3=srf_17, Data4=srf_14, Data5=srf_13)
surface_keystoning_2 = PythonScript(srf_1=srf_15, srf_2=srf_16, srf_3=srf_17, srf_4=srf_14, srf_set=srf_10)  # -> out, isocurve_visualisation, blend_crvs_vis, crv_vis, new_surfaces, visualize_uv_switched_crvs; inputs srf_1: Surface, srf_2: Surface, srf_3: Surface, srf_4: Surface, srf_set: list of Surface; same code as surface_keystoning
merge_3 = Merge()
merge_4 = Merge()
panel = Panel(surface_keystoning.out)
pt = Point(surface_keystoning.uv_switched_pts)
crv = Curve(surface_keystoning.uv_switched_crvs)
srf_19 = Surface(srf_12)
srf_20 = Surface([<surface referenced from the Rhino model> x3])
srf_21 = Surface(surface_keystoning.keystone_srfs)
surface_keystoning_3 = PythonScript(
    srf_1=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,
    srf_2=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,
    srf_3=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,
    srf_4=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,
    srf_set=srf_19)  # -> out, isocurve_visualisation, blend_crvs_vis, crv_vis, new_surfaces, visualize_uv_switched_crvs; inputs srf_1: Surface, srf_2: Surface, srf_3: Surface, srf_4: Surface, srf_set: list of Surface; same code as surface_keystoning
srf_22 = Surface(surface_keystoning_2.new_surfaces)
srf_23 = Surface(srf_11)
srf_24 = Surface(srf_18)
surface_keystoning_4 = PythonScript(
    srf_1=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,
    srf_2=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,
    srf_3=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,
    srf_4=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,
    srf_set=srf_23)  # -> out, isocurve_visualisation, blend_crvs_vis, crv_vis, new_surfaces, visualize_uv_switched_crvs; inputs srf_1: Surface, srf_2: Surface, srf_3: Surface, srf_4: Surface, srf_set: list of Surface; same code as surface_keystoning
v_div = Slider(6, range=0..100)
surface_keystoning_5 = PythonScript(
    srf_1=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,
    srf_2=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,
    srf_3=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,
    srf_4=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,
    srf_set=srf_24)  # -> out, isocurve_visualisation, blend_crvs_vis, crv_vis, new_surfaces, visualize_uv_switched_crvs; inputs srf_1: Surface, srf_2: Surface, srf_3: Surface, srf_4: Surface, srf_set: list of Surface; same code as surface_keystoning
u_div = Slider(5, range=0..100)
srf_25 = Surface(srf_10)
v_div_2 = Slider(8, range=0..100)
u_div_2 = Slider(8, range=0..100)
surface_keystoning_6 = PythonScript(
    srf_1=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,
    srf_2=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,
    srf_3=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,
    srf_4=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,
    srf_set=srf_25)  # -> out, isocurve_visualisation, blend_crvs_vis, crv_vis, new_surfaces, visualize_uv_switched_crvs; inputs srf_1: Surface, srf_2: Surface, srf_3: Surface, srf_4: Surface, srf_set: list of Surface; same code as surface_keystoning
v_div_3 = Slider(8, range=0..100)
u_div_3 = Slider(8, range=0..100)
surface_keystoning_7 = PythonScript(
    srf_1=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,
    srf_2=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,
    srf_3=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,
    srf_4=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,
    srf_set=srf_20)  # -> out, isocurve_visualisation, blend_crvs_vis, crv_vis, new_surfaces, visualize_uv_switched_crvs; inputs srf_1: Surface, srf_2: Surface, srf_3: Surface, srf_4: Surface, srf_set: list of Surface; same code as surface_keystoning
v_div_4 = Slider(8, range=0..100)
u_div_4 = Slider(8, range=0..100)
srf_26 = Surface(surface_keystoning_3.new_surfaces)
srf_27 = Surface(surface_keystoning_4.new_surfaces)
number_slider = Slider(20, range=0..100)
number_slider_2 = Slider(7, range=0..20)
srf_28 = Surface(surface_keystoning_5.new_surfaces)
v_div_5 = Slider(6, range=0..100)
u_div_5 = Slider(5, range=0..100)
number_slider_3 = Slider(20, range=0..100)
number_slider_4 = Slider(7, range=0..20)
srf_29 = Surface(surface_keystoning_6.new_surfaces)
number_slider_5 = Slider(20, range=0..100)
number_slider_6 = Slider(7, range=0..20)
number_slider_7 = Slider(20, range=0..100)
number_slider_8 = Slider(7, range=0..20)
srf_30 = Surface(surface_keystoning_7.new_surfaces)
srf_31 = Surface(srf_26)
number_slider_9 = Slider(20, range=0..100)
number_slider_10 = Slider(7, range=0..20)
panel_2 = Panel(surface_keystoning_7.out)
srf_32 = Surface(srf_27)
srf_33 = Surface(srf_28)
srf_34 = Surface(srf_29)
surface_trimming = PythonScript(srf=surface_keystoning.keystone_srfs, value=number_slider, v_div=number_slider_2)  # -> out, isocurves, temp_surface, hole_visualisation; inputs srf: Surface, value: Int32, v_div: Int32
# ---------- surface_trimming: Python ----------
# snippet of code to make this python component look for it's code in the parent folder of the .gh file

import os

ghComp = ghenv.Component
ghDoc = ghComp.OnPingDocument()

file_name = "surface_offset.py"
gh_file_location = ghDoc.FilePath
parent = os.path.dirname(os.path.realpath(gh_file_location))

file_path = os.path.join(parent, file_name)
# print file_path

single_parent = os.path.dirname(os.path.realpath(parent))
double_parent = os.path.dirname(os.path.realpath(single_parent))
# print parent

# hacky-hacky run-fun
execfile(file_path)
# ---------- end surface_trimming ----------
srf_35 = Surface(srf_30)
surface_trimming_2 = PythonScript(srf=srf_31, value=number_slider, v_div=number_slider_2)  # -> out, isocurves, temp_surface, hole_visualisation; inputs srf: Surface, value: Int32, v_div: Int32; same code as surface_trimming
surface_trimming_3 = PythonScript(srf=srf_23, value=number_slider_3, v_div=number_slider_4)  # -> out, isocurves, temp_surface, hole_visualisation; inputs srf: Surface, value: Int32, v_div: Int32; same code as surface_trimming
surface_trimming_4 = PythonScript(srf=srf_32, value=number_slider_3, v_div=number_slider_4)  # -> out, isocurves, temp_surface, hole_visualisation; inputs srf: Surface, value: Int32, v_div: Int32; same code as surface_trimming
u_div_6 = Number(u_div_5)
v_div_6 = Number(v_div_5)
surface_trimming_5 = PythonScript(srf=srf_24, value=number_slider_5, v_div=number_slider_6)  # -> out, isocurves, temp_surface, hole_visualisation; inputs srf: Surface, value: Int32, v_div: Int32; same code as surface_trimming
surface_trimming_6 = PythonScript(srf=srf_33, value=number_slider_5, v_div=number_slider_6)  # -> out, isocurves, temp_surface, hole_visualisation; inputs srf: Surface, value: Int32, v_div: Int32; same code as surface_trimming
u_div_7 = Slider(12, range=0..100)
u_div_8 = Number(u_div)
v_div_7 = Number(v_div)
surface_trimming_7 = PythonScript(srf=srf_25, value=number_slider_7, v_div=number_slider_8)  # -> out, isocurves, temp_surface, hole_visualisation; inputs srf: Surface, value: Int32, v_div: Int32; same code as surface_trimming
surface_trimming_8 = PythonScript(srf=srf_34, value=number_slider_7, v_div=number_slider_8)  # -> out, isocurves, temp_surface, hole_visualisation; inputs srf: Surface, value: Int32, v_div: Int32; same code as surface_trimming
u_div_9 = Number(u_div_5)
v_div_8 = Number(v_div_5)
u_div_10 = Slider(2, range=0..100)
surface_trimming_9 = PythonScript(srf=srf_20, value=number_slider_9, v_div=number_slider_10)  # -> out, isocurves, temp_surface, hole_visualisation; inputs srf: Surface, value: Int32, v_div: Int32; same code as surface_trimming
surface_trimming_10 = PythonScript(srf=srf_35, value=number_slider_9, v_div=number_slider_10)  # -> out, isocurves, temp_surface, hole_visualisation; inputs srf: Surface, value: Int32, v_div: Int32; same code as surface_trimming
u_div_11 = Number(u_div)
v_div_9 = Number(v_div)
u_div_12 = Number(u_div)
v_div_10 = Number(v_div)
panel_3 = Panel(surface_trimming.out)
int = Integer(0)
int_2 = Integer(1)
int_3 = Integer(1)
int_4 = Integer(0)
python = PythonScript(surface=surface_trimming.temp_surface, u_div=u_div_7, v_div=v_div_6, start_position=int, add_extra_beam=Toggle(False))  # -> out, hole_visualisation, beam_visualisation; inputs surface: Surface, u_div: Int32, v_div: Int32
# ---------- python: Python ----------
# snippet of code to make this python component look for it's code in the parent folder of the .gh file

import os

ghComp = ghenv.Component
ghDoc = ghComp.OnPingDocument()

file_name = "simple_surface_divider.py"
gh_file_location = ghDoc.FilePath
parent = os.path.dirname(os.path.realpath(gh_file_location))

file_path = os.path.join(parent, file_name)
# print file_path

single_parent = os.path.dirname(os.path.realpath(parent))
double_parent = os.path.dirname(os.path.realpath(single_parent))
# print parent

# hacky-hacky run-fun
execfile(file_path)
# ---------- end python ----------
python_2 = PythonScript(surface=surface_trimming_2.temp_surface, u_div=u_div_6, v_div=v_div_6, start_position=int, add_extra_beam=Toggle(False))  # -> out, beam_visualisation; inputs surface: Surface, u_div: Int32, v_div: Int32; same code as python
int_5 = Integer(0)
python_3 = PythonScript(surface=surface_trimming_3.temp_surface, u_div=u_div_10, v_div=v_div_7, start_position=int_3)  # -> out, beam_visualisation; inputs surface: Surface, u_div: Int32, v_div: Int32; same code as python
python_4 = PythonScript(surface=surface_trimming_4.temp_surface, u_div=u_div_8, v_div=v_div_7, start_position=int_3)  # -> out, beam_visualisation; inputs surface: Surface, u_div: Int32, v_div: Int32; same code as python
python_5 = PythonScript(
    surface=surface_trimming_5.temp_surface,
    u_div=[u_div_9, u_div_7],
    v_div=v_div_8,
    start_position=int_2,
    add_extra_beam=Toggle(False))  # -> out, beam_visualisation; inputs surface: Surface, u_div: Int32, v_div: Int32; same code as python
python_6 = PythonScript(
    surface=surface_trimming_6.temp_surface,
    u_div=u_div_9,
    v_div=v_div_8,
    start_position=int_2,
    add_extra_beam=Toggle(False))  # -> out, beam_visualisation; inputs surface: Surface, u_div: Int32, v_div: Int32; same code as python
python_7 = PythonScript(surface=surface_trimming_7.temp_surface, u_div=[u_div_11, u_div_10], v_div=v_div_9, start_position=int_4)  # -> out, beam_visualisation; inputs surface: Surface, u_div: Int32, v_div: Int32; same code as python
python_8 = PythonScript(surface=surface_trimming_8.temp_surface, u_div=u_div_11, v_div=v_div_9, start_position=int_4)  # -> out, beam_visualisation; inputs surface: Surface, u_div: Int32, v_div: Int32; same code as python
python_9 = PythonScript(surface=surface_trimming_9.temp_surface, u_div=[u_div_12, u_div_10], v_div=v_div_10, start_position=int_5)  # -> out, beam_visualisation; inputs surface: Surface, u_div: Int32, v_div: Int32; same code as python
python_10 = PythonScript(surface=surface_trimming_10.temp_surface, u_div=u_div_12, v_div=v_div_10, start_position=int_5)  # -> out, beam_visualisation; inputs surface: Surface, u_div: Int32, v_div: Int32; same code as python
pt_2 = Point(python.hole_visualisation)
brep = Brep(python.beam_visualisation)
brep_2 = Brep(python_2.beam_visualisation)
brep_3 = Brep(python_3.beam_visualisation)
brep_4 = Brep(python_4.beam_visualisation)
panel_4 = Panel(python.out)
brep_5 = Brep(python_5.beam_visualisation)
brep_6 = Brep(python_6.beam_visualisation)
merge_5 = Merge(Data1=brep, Data2=brep_2)
brep_7 = Brep(python_7.beam_visualisation)
brep_8 = Brep(python_8.beam_visualisation)
merge_6 = Merge(Data1=brep_3, Data2=brep_4)
merge_7 = Merge(Data1=brep_5, Data2=brep_6)
brep_9 = Brep(python_9.beam_visualisation)
brep_10 = Brep(python_10.beam_visualisation)
merge_8 = Merge(Data1=brep_7, Data2=brep_8)
merge_9 = Merge(Data1=brep_9, Data2=brep_10)
brep_11 = Brep(merge_5)
brep_12 = Brep(merge_7)
brep_13 = Brep(merge_6)
brep_14 = Brep(merge_8)
brep_15 = Brep(merge_9)
preview_2 = CustomPreview(Geometry=brep_11, Shader=ColourSwatch(SwatchColor=RGB(255, 255, 255)))
